# Dynamo graph Reset_script.dyn (Dynamo 2.6.1.8786)

# group: output data
code_block = CodeBlock()
# ---------- code_block.designscript (10 lines) ----------
FamilyType.ByName("DASHBOARD_BAR GRAPH");
[
	"CAD Links",
	"File Size",
	"Groups",
	"In Place Families",
	"Warnings High",
	"Warnings Medium"
];
0;
# ----------------------------------------
setParameterByName = Element.SetParameterByName(element=code_block.out0, parameterName=code_block.out1, value=code_block.out2)

# group: output message
code_block_2 = CodeBlock(value=setParameterByName)
# ---------- code_block_2.designscript (10 lines) ----------
DSCore.List.FirstItem(DSCore.Object.IsNull(value))?

//enter custom error message
"Error:" + "\n\n" + "The model health dashboard could not be updated.":

//enter custom success message
"Success:" + "\n\n" + "The model health dashboard was reset.";

//feedback form
"https://forms.office.com/Pages/ResponsePage.aspx?id=uTIU8X7PkEi0BHP28fj9b_7Z0NrgX9VIhN4eWRF1bs9UQU9QRUZMR0JONUdCOU5JS0QyTFIyNVhGNyQlQCN0PWcu";
# ----------------------------------------
python_script = Python(IN[0]=code_block_2.out0, IN[1]=code_block_2.out1)
# ---------- python_script.python (16 lines) ----------
# python script to create dialog box

import clr
clr.AddReference('RevitAPIUI')

from Autodesk.Revit.UI import TaskDialog

message = IN[0]
help = "<a href=\"" + IN[1] + "\">" + "Help</a>";

dialog = TaskDialog('Result')
dialog.TitleAutoPrefix = False
dialog.MainContent = message
dialog.FooterText = help

result = dialog.Show()
# ----------------------------------------
