# Dynamo graph Health_script.dyn (Dynamo 2.12.0.5650)

# group: fileSize
current = Document.Current()
filePath = Document.FilePath(document=current)
python_script = Python(IN[0]=filePath)  # IronPython2
# ---------- python_script.python (15 lines) ----------
import os
import clr

clr.AddReference("RevitAPI")
from Autodesk.Revit.DB import ModelPathUtils

clr.AddReference("RevitServices")
import RevitServices
from RevitServices.Persistence import DocumentManager 

doc = DocumentManager.Instance.CurrentDBDocument
modelPath = doc.GetWorksharingCentralModelPath()
centralPath = ModelPathUtils.ConvertModelPathToUserVisiblePath(modelPath)

OUT = os.path.getsize(centralPath), centralPath
# ----------------------------------------
code_block = CodeBlock(data=python_script)
# ---------- code_block.designscript (8 lines) ----------
//bytes
data[0];
//megabytes
data[0]/1000000;
//gigabytes
data[0]/1000000000;
//path
data[1];
# ----------------------------------------
watch = Watch(code_block.out3)
code_block_2 = CodeBlock(data=code_block.out1) { Math.Round(data,2); }

# group: cadLinks
element_types = ElementTypes("CADLinkType")
all_elements_of_type = ElementsOfType(element_type=element_types)
count = List.Count(list=all_elements_of_type)

# group: groups
element_types_2 = ElementTypes("Group")
all_elements_of_type_2 = ElementsOfType(element_type=element_types_2)
code_block_3 = CodeBlock(elements=all_elements_of_type_2) { elements; category = Element.GetCategory(elements); name = Category.Name(category); name == "Model Groups"; }
filterByBoolMask = List.FilterByBoolMask(list=code_block_3.elements, mask=code_block_3.out3)
count_2 = List.Count(list=filterByBoolMask.in)

# group: inPlace
element_types_3 = ElementTypes("Family")
all_elements_of_type_3 = ElementsOfType(element_type=element_types_3)
python_script_2 = Python(IN[0]=all_elements_of_type_3)  # IronPython2
# ---------- python_script_2.python (14 lines) ----------
import clr

#Load Revit API
clr.AddReference('RevitAPI')
from Autodesk.Revit.DB import *

families = UnwrapElement(IN[0])
inplace = []

for f in families:
	if f.IsInPlace:
		inplace.append(f)
		
OUT = inplace
# ----------------------------------------
count_3 = List.Count(list=python_script_2)

# group: warnings
string = StringInput("\\local.serapdx.com\data\Support\ProgramData\AutoDesk\Revit\Warning Ranks.xlsx")
file_from_path = FileObject(path=string)
code_block_4 = CodeBlock { "Warnings"; true; false; }
# note: What is the Warning Type Id?
# I can't find this in the API.
importExcel = Data.ImportExcel(file=file_from_path, sheetName=code_block_4.out0, readAsStrings=code_block_4.out1, showExcel=code_block_4.out2)
restOfItems = List.RestOfItems(list=importExcel)
number = DoubleInput(1)
getItemAtIndex = List.GetItemAtIndex(index=number)  # unwired: list
groupByFunction = List.GroupByFunction(list=restOfItems, groupFunction=getItemAtIndex)
number_2 = DoubleInput(2)
# note: I'd rather grab an Id or some number.
# Description might have spelling errors in Excel.
getItemAtIndex_2 = List.GetItemAtIndex(list=groupByFunction@@L2, index=number_2)
trimWhitespace = String.TrimWhitespace(string=getItemAtIndex_2)
code_block_5 = CodeBlock { "."; }
endsWith = String.EndsWith(string=trimWhitespace, searchFor=code_block_5)
code_block_6 = CodeBlock(endsWithPeriod=endsWith, data=trimWhitespace) { endsWithPeriod?data:data+"."; }
python_script_3 = Python()  # IronPython2
# ---------- python_script_3.python (29 lines) ----------
# inspired by https://andrewkingme.com/work/Revit-Model-Health-Report/

import clr

# Import RevitAPI
clr.AddReference('RevitAPI')
import Autodesk

# Import DocumentManager
clr.AddReference('RevitServices')
import RevitServices
from RevitServices.Persistence import DocumentManager

# Import FailureMessage Class
import Autodesk 
from Autodesk.Revit.DB import FailureMessage as FM

warnings = DocumentManager.Instance.CurrentDBDocument.GetWarnings()
descriptions = []
elements = []
types = []

for warning in warnings:
	descriptions.append(FM.GetDescriptionText(warning))
	elements.append(FM.GetFailingElements(warning))
	types.append(FM.GetType(warning).ToString())
	
	
OUT = descriptions, elements, types
# ----------------------------------------
code_block_7 = CodeBlock(OUT=python_script_3) { OUT[0]; OUT[1]; OUT[2]; }
watch_2 = Watch(code_block_7.out0)
contains = List.Contains(list=code_block_6@L2, item=watch_2, lacing=CrossProduct)
countTrue = List.CountTrue(list=contains@L2)

# group: output data
code_block_8 = CodeBlock(cadLinks=count, fileSize=code_block_2, groups=count_2, inPlace=count_3, warnings=countTrue)
# ---------- code_block_8.designscript (8 lines) ----------
[
	cadLinks,
	fileSize,
	groups,
	inPlace,
	warnings[0],
	warnings[1]
];
# ----------------------------------------
code_block_9 = CodeBlock(data=code_block_8)
# ---------- code_block_9.designscript (10 lines) ----------
FamilyType.ByName("DASHBOARD_BAR GRAPH");
[
	"CAD Links",
	"File Size",
	"Groups",
	"In Place Families",
	"Warnings High",
	"Warnings Medium"
];
Math.Ceiling(data);
# ----------------------------------------
setParameterByName = Element.SetParameterByName(element=code_block_9.out0, parameterName=code_block_9.out1, value=code_block_9.out2)

# group: set parameters, then run output message
isEmpty = List.IsEmpty(list=setParameterByName)
isNull = Object.IsNull(object=setParameterByName)
code_block_10 = CodeBlock { true; }
contains_2 = List.Contains(list=isNull, item=code_block_10)
or_ = isEmpty || contains_2

# group: output message
code_block_11 = CodeBlock(emptyOrNull=or_)
# ---------- code_block_11.designscript (10 lines) ----------
emptyOrNull?

//enter custom error message
"Error:" + "\n\n" + "The model health dashboard could not be updated.":

//enter custom success message
"Success:" + "\n\n" + "The model health dashboard was successfully updated.";

//feedback form
"https://forms.office.com/Pages/ResponsePage.aspx?id=uTIU8X7PkEi0BHP28fj9b_7Z0NrgX9VIhN4eWRF1bs9UQU9QRUZMR0JONUdCOU5JS0QyTFIyNVhGNyQlQCN0PWcu";
# ----------------------------------------
python_script_4 = Python(IN[0]=code_block_11.out0, IN[1]=code_block_11.out1)  # IronPython2
# ---------- python_script_4.python (16 lines) ----------
# python script to create dialog box

import clr
clr.AddReference('RevitAPIUI')

from Autodesk.Revit.UI import TaskDialog

message = IN[0]
help = "<a href=\"" + IN[1] + "\">" + "Help</a>";

dialog = TaskDialog('Result')
dialog.TitleAutoPrefix = False
dialog.MainContent = message
dialog.FooterText = help

result = dialog.Show()
# ----------------------------------------

# group: datetime
code_block_12 = CodeBlock { "Datetime"; DateTime.Now; }
string_from_object = FromObject(obj=code_block_12.out1)
setParameterByName_2 = Element.SetParameterByName(element=code_block_9.out0, parameterName=code_block_12.out0, value=string_from_object)
