# Dynamo graph Setup_script.dyn (Dynamo 2.6.1.8786)

element_types = ElementTypes("ProjectInfo")
all_elements_of_type = ElementsOfType(element_type=element_types)
code_block = CodeBlock { list[0]; list[1]; list[2]; list[3]; list[4]; list[5]; list[6]; list[7]; list[8]; list[9]; list[10]; list[11]; }  # unwired: list
code_block_2 = CodeBlock(projectNumber=code_block.out0, projectName=code_block.out1, clientName=code_block.out2, projectIssueDate=code_block.out3, projectStatus=code_block.out4, projectAddress=code_block.out5, principleInCharge=code_block.out6, projectManager=code_block.out7, projectArchitect=code_block.out8, jobCaptain=code_block.out9, team=code_block.out10, projectNotes=code_block.out11)
# ---------- code_block_2.designscript (31 lines) ----------
// Project Information
// parameter names
[
	"Project Number",
	"Project Name",
	"Client Name",
	"Project Issue Date",
	"Project Status",
	"Project Address",
	"Principle in Charge",
	"Project Manager",
	"Project Architect",
	"Job Captain",
	"Team",
	"Project Notes"
];
// parameter data
[
	projectNumber,
	projectName,
	clientName,
	projectIssueDate,
	projectStatus,
	projectAddress,
	principleInCharge,
	projectManager,
	projectArchitect,
	jobCaptain,
	team,
	projectNotes
];
# ----------------------------------------
setParameterByName = Element.SetParameterByName(element=all_elements_of_type, parameterName=code_block_2.out0, value=code_block_2.out1, lacing=Longest)

# group: import Excel data
file_path = Filename("No file selected.")
file_from_path = FileObject(path=file_path)
code_block_3 = CodeBlock()
# ---------- code_block_3.designscript (4 lines) ----------
//update based on report
"Sheet Name";
true;
false;
# ----------------------------------------
importExcel = Data.ImportExcel(file=file_from_path, sheetName=code_block_3.out0, readAsStrings=code_block_3.out1, showExcel=code_block_3.out2)

code_block_4 = CodeBlock(data=importExcel) { data; }
